# Grasshopper definition Curves.gh (Grasshopper 1.0.7)

panel = Panel("""1
2
2
1""")
number_slider = Slider(34, range=10..200)
crv = Curve(reparameterize(<curve referenced from the Rhino model>))
series = Series(Start="0", Step=panel, Count="10")
crv_2 = Curve(<curve referenced from the Rhino model>)
remap = RemapNumbers(Value=series, Source=crv, Target="0 to 1")  # -> Mapped, Clipped
eval = EvaluateCurve(Curve=crv, Parameter=remap.Mapped)  # -> Point, Tangent, Angle
divide = DivideCurve(Curve=crv, Count=10, Kinks=False)  # -> Points, Tangents, Parameters
eval_2 = EvaluateCurve()  # -> Point, Tangent, Angle
divide_2 = DivideCurve(Curve=crv_2, Count=Slider(40, range=10..200), Kinks=False)  # -> Points, Tangents, Parameters
panel_2 = Panel("""true
true
true
false
false""")
panel_3 = Panel("""true
true
true
false
false""")
dom = ConstructDomain(DomainStart=Slider(19, range=10..200), DomainEnd=Slider(112, range=10..200))
dispatch = Dispatch(List=eval.Point, DispatchPattern=panel_2)  # -> ListA, ListB
dispatch_2 = Dispatch(List=divide_2.Points, DispatchPattern=panel_3)  # -> ListA, ListB
dom_2 = ConstructDomain(DomainStart=Slider(19, range=10..200), DomainEnd=Slider(112, range=10..200))
pt = Point(dispatch.ListA)
pt_2 = Point(dispatch.ListB)
lng = ListLength(List=pt_2)
pt_3 = Point(dispatch_2.ListA)
pt_4 = Point(dispatch_2.ListB)
lng_2 = ListLength(List=pt_4)
random = Random(Range=lng_2, Number=dom, Seed=2)
X = UnitX(Factor=Slider(3, range=1..10))  # disabled
random_2 = Random(Range=lng, Number=dom_2, Seed=2)
move = Move(Geometry=pt_3, Motion=X)  # -> Geometry, Transform
Z = UnitZ(Factor=Slider(3, range=1..100))
Z_2 = UnitZ(Factor=Slider(3, range=1..100))
panel_4 = Panel("""0
0
0
1
1""")
move_2 = Move(Geometry=pt_2, Motion=Z)  # -> Geometry, Transform
move_3 = Move(Geometry=pt_4, Motion=Z_2)  # -> Geometry, Transform
panel_5 = Panel("""0
0
0
1
1""")
weave = Weave(Pattern=panel_5, Stream0=pt, Stream1=move_2.Geometry, NullGaps=False)
weave_2 = Weave(Pattern=panel_4, Stream0=pt_3, Stream1=move_3.Geometry, NullGaps=False)
intcrv = Interpolate(Vertices=weave, Degree=3, Periodic=False, KnotStyle=1)  # -> Curve, Length, Domain
crv_3 = Curve(<curve referenced from the Rhino model>)
intcrv_2 = Interpolate(Vertices=weave_2, Degree=3, Periodic=False, KnotStyle=1)  # -> Curve, Length, Domain
extrcrv = ExtrudeAlong(Base=intcrv.Curve, Curve=crv_3)
crv_4 = Curve(<curve referenced from the Rhino model>)
extrcrv_2 = ExtrudeAlong(Base=intcrv_2.Curve, Curve=crv_4)
brep = Brep(extrcrv_2)
